# Grasshopper definition test.gh (Grasshopper 1.0.7)
# plug-ins: FloorPlanGenerator

curve = Curve(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)
point = Point(Point(3.472079264, -2.480056617, 0))
houseinstance = HouseInstance(Boundary=curve, EntrancePoint=point)
roominstance = RoomInstance()
trigger = Trigger(Interval=20, TimerInterval=20, Target=magnetizingrooms_heapes)  # disabled
roominstance_2 = RoomInstance()
number_slider = Slider(0, range=0..10)
magnetizingrooms_heapes = MagnetizingRooms_HeapES(
    HouseInstance=houseinstance,
    Iterations=Slider(200, range=0..1000),
    MaxAdjDistance=Slider(3, range=0..10),
    DisplayNumber=Slider(3, range=0..10),
    GapOfResult=Slider(1, range=0..10))  # -> Corridors, RoomBreps, RoomNames, Adjacencies, MissingAdjacences
tree_branch = TreeBranch(Tree=magnetizingrooms_heapes.Corridors, Path=number_slider, MaintainPaths=True)
tree_branch_2 = TreeBranch(Tree=magnetizingrooms_heapes.RoomNames, Path=number_slider, MaintainPaths=True)
tree_branch_3 = TreeBranch(Tree=magnetizingrooms_heapes.RoomBreps, Path=number_slider, MaintainPaths=True)
tree_branch_4 = TreeBranch(Tree=magnetizingrooms_heapes.Adjacencies, Path=number_slider, MaintainPaths=True)
tree_branch_5 = TreeBranch(Tree=magnetizingrooms_heapes.MissingAdjacences, Path=number_slider, MaintainPaths=True)
brep = Brep(tree_branch)
custom_preview = CustomPreview(Geometry=brep, Material=ColourSwatch(SwatchColor=RGB(255, 255, 255)))
list_item = ListItem(List=tree_branch_3, Index=Slider(0, range=0..10), Wrap=True)
custom_preview_2 = CustomPreview(Geometry=tree_branch_3, Material=ColourSwatch(SwatchColor=RGB(0, 255, 30)))
